# Grasshopper definition Rlab_SIM_Fondecyt.gh (Grasshopper 1.0.8)
# plug-ins: Robots, Pufferfish

# ---- group: MESA / GEOMETRIA MESA
brep = Brep(<brep referenced from the Rhino model>)

# ---- group: MESA
debrep = DeconstructBrep(Brep=brep)  # -> Faces, Edges, Vertices
item = ListItem(List=debrep.Faces, Index="5", Wrap=True)
Y = UnitY(Factor="0")
area = Area(Geometry=item)  # -> Area, Centroid
move = Move(Geometry=area.Centroid, Motion=Y)  # -> Geometry, Transform
xy = XYPlane(Origin=move.Geometry)

# ---- group: TRAZADO DE PIEZAS
geo = Geometry(<surface referenced from the Rhino model>)

# ----
xy_2 = XYPlane(Origin=Point(0, 0, 0))
move2pt = MoveToPoint(Geometry=geo, PointA=xy_2, PointB=xy)  # -> Moved, Vector, Transform

division = Division(A=Slider(0, range=0..100), B="2")
int = Integer(division)

# ---- group: offset de prueba
Z = UnitZ(Factor="200")

# ---- group: zonedata
panel = Panel("20")

# ---- group: Wobj
pt = ConstructPoint(XCoordinate="1245.84", YCoordinate="-439.55", ZCoordinate="144.58")
pl = ConstructPlane(Origin=pt, XAxis=Vector(1, 0, 0), YAxis=Vector(0, 1, 0))
frame = CreateFrame(Plane=pl, CoupledMechanicalGroup=-1, CoupledMechanism=-1, Name="WobjLamp")

# ----
pt_2 = Point(<point referenced from the Rhino model>)

# ---- group: Tooldata Extrusor
mesh = Mesh([<mesh referenced from the Rhino model> x4])
mjoin = MeshJoin(Meshes=mesh)
volume = Volume(Geometry=mjoin)  # -> Volume, Centroid
panel_2 = Panel("Efector_fondecyt")
panel_3 = Panel("8.4")

# ----
list = RobotsLibrary({"UC-IRB2600-IOmod", "UC-IRB2600"}, selected="UC-IRB2600-IOmod", Type=0)
zone = ZoneParameter(panel)
yz = YZPlane(Origin=pt_2)
xy_3 = XYPlane(Origin=pt_2)

# ---- group: Speeddata
radians = Radians(Degrees="30")
create_speed = CreateSpeed(
    Translation="100",
    Rotation=radians,
    ExternalTranslation=5000,
    ExternalRotation=18.84955592,
    AccelTranslation=2500,
    AccelAxis=12.56637061)

# ----
xy_4 = XYPlane(Origin=Point(0, 0, 0))
load_robot_system = LoadRobotSystem(Name=list, Base=xy_4)
robot_system_parameter = RobotSystemParameter(load_robot_system)

rotate = Rotate(Geometry=xy_3, Angle=degrees("90"), Plane=yz)  # -> Geometry, Transform

# ---- group: Home Pos
rad = Radians(Degrees=Slider(-45, range=-180..180))
rad_2 = Radians(Degrees=Slider(0, range=-400..400))
rad_3 = Radians(Degrees=Slider(30, range=-120..120))
rad_4 = Radians(Degrees=Slider(60, range=-65..185))
rad_5 = Radians(Degrees=Slider(-90, range=-400..400))
rad_6 = Radians(Degrees=Slider(0, range=-75..180))
concat = Concatenate(
    FragmentA=rad,
    FragmentB=",",
    FragmentA_2=rad_4,
    FragmentB_2=",",
    FragmentC=rad_6,
    FragmentD=",",
    FragmentA_3=rad_2,
    FragmentB_3=",",
    FragmentC_2=rad_3,
    FragmentD_2=",",
    FragmentA_4=rad_5)
speed = SpeedParameter(create_speed)

# ----
xz = XZPlane(Origin=pt_2)
rotate_2 = Rotate(Geometry=rotate.Geometry, Angle=degrees("90"), Plane=xz)  # -> Geometry, Transform
create_tool = CreateTool(Name=panel_2, TCP=rotate_2.Geometry, Weight=panel_3, Centroid=volume.Centroid, Mesh=mjoin)  # -> Tool, TCP
frame_2 = FrameParameter(frame)
speed_2 = SpeedParameter(create_speed)

# ---- group: Lector de Targets
frame_parameter = FrameParameter(frame_2)

# ----
tool_parameter = ToolParameter(create_tool.Tool)
tool_parameter_2 = ToolParameter(tool_parameter)
tool_parameter_3 = ToolParameter(tool_parameter)
zone_2 = ZoneParameter(panel)
create_target = CreateTarget(Joints=concat, Tool=tool_parameter_2, Speed=speed, IsCartesian=False)
# Diferencia primera capa y n+
panel_4 = Panel("Porcentaje de compresión")
tool_parameter_4 = ToolParameter(tool_parameter)

# ---- group: Home
target = TargetParameter(create_target)

# ----
list_2 = FlagFields({"Shoulder": 1, "Elbow": 2, "Wrist": 4}, selected=[])
list_3 = ValueList({"Joint", "Linear"}, selected="Linear")

wait = Wait(Time="0.5")
wait_2 = Wait(Time="0.5")
wait_3 = Wait(Time="3")
setdo = SetDO(DO="1", Value="0")
setdo_2 = SetDO(DO="1", Value="1")
setdo_3 = SetDO(DO="0", Value="0")
setdo_4 = SetDO(DO="0", Value="1")
merge = Merge(Data1=setdo_4, Data2=wait_2, Data3=setdo_3, Data4=wait_3, Data5=setdo_2, Data6=wait, Data7=setdo)

wait_4 = Wait(Time="0.5")
setdo_5 = SetDO(DO="3", Value="1")
setdo_6 = SetDO(DO="3", Value="0")
merge_2 = Merge(Data1=setdo_5, Data2=wait_4, Data3=setdo_6)

panel_5 = Panel("""UIMsgBox \Header:= "Chequeo recarga efector", "Confirme recarga" 
\Buttons:=btnOK \Icon:=iconInfo \MaxTime:=600 """)
panel_6 = Panel("""TEST err_var
CASE ERR_TP_MAXTIME:
  TPWrite "Sin respuesta en 600 s - programa en pausa";
  Stop;                     
DEFAULT:
  ! err_var = 0 -> el operador pulso el boton: seguir
ENDTEST""")
customcommand = CustomCommand(Name="Espera_Robot", Manufacturer="ABB", Code="WaitRob \InPos;")
setdo_7 = SetDO(DO="2", Value="1")
customcommand_2 = CustomCommand(Name="Chequeo_Recarga_robot", Manufacturer="ABB", Code=panel_5, Declaration=panel_6)
wait_5 = Wait(Time="0.5")
setdo_8 = SetDO(DO="2", Value="0")
merge_3 = Merge(Data1=customcommand, Data2=setdo_7, Data3=wait_5, Data4=setdo_8, Data5=customcommand_2)

groupcommand = GroupCommand(Commands=merge_2)

Z_2 = UnitZ(Factor="-45")

# ---- group: extrude
command = CommandParameter(groupcommand)

# ----
groupcommand_2 = GroupCommand(Commands=merge)
target_2 = TargetParameter(create_target)
deconstructtarget = DeconstructTarget(Target=target_2)  # -> Joints, Tool, Speed, Zone

# ---- group: Cut
command_2 = CommandParameter(groupcommand_2)

# ----
groupcommand_3 = GroupCommand(Commands=merge_3)

# ---- group: go to rest
command_3 = CommandParameter(groupcommand_3)

# ----
createtarget = CreateTarget(
    Joints=deconstructtarget.Joints,
    Tool=deconstructtarget.Tool,
    Speed=deconstructtarget.Speed,
    Zone=deconstructtarget.Zone,
    Command=command_3,
    IsCartesian=False)
robot_system_parameter_2 = RobotSystemParameter(robot_system_parameter)

# ---- group: OUTPUT
relay = Relay()

# ---- group: OUTPUT / RCP
button = Button()
button_2 = Button()
button_3 = Button()

# ---- group: OUTPUT / Chequeo de colisión
panel_7 = Panel("""3
4
5""")
collisions = CheckCollisions(
    Program=relay,
    FirstSet=flatten(panel_7),
    SecondSet=flatten("7"),
    EnvironmentPlane=-1,
    LinearStepSize="100",
    AngularStepSize=0.7853981634)  # -> CollisionFound, TargetIndex, CollidedMeshes

# ---- group: Posiciones tubos
panel_8 = Panel("65")

# ----
series = Series(Start=0, Step=panel_8, Count="4")

# ---- group: Posiciones tubos (continued)
Z_3 = UnitZ(Factor=series)
move_2 = Move(Geometry=xy, Motion=Z_3)  # -> Geometry, Transform
sec = BrepPlane(Brep=move2pt.Moved, Plane=move_2.Geometry)  # -> Curves, Points
len = Length(Curve=sec.Curves)
division_2 = Division(A=len, B="28")
series_2 = Series(Start=0, Step="28", Count=expr("x", division_2))

# ----
eval = EvaluateLength(Curve=sec.Curves, Length=series_2, Normalized=Toggle(False))  # -> Point, Tangent, Parameter

# ---- group: Posiciones tubos (continued)
cir = Circle(Plane=eval.Point, Radius="25")
suirify = Suirify(cir)
tstat = TreeStatistics(Tree=suirify)  # -> Paths, Length, Count
series_3 = Series(Start=0, Step=1, Count=tstat.Count)
dispatch = Dispatch(List=series_3, DispatchPattern=[True, False])  # -> ListA, ListB
branch = TreeBranch(Tree=suirify, Path=dispatch.ListB, MaintainPaths=True)
branch_2 = TreeBranch(Tree=suirify, Path=dispatch.ListA, MaintainPaths=True)
dispatch_2 = Dispatch(List=branch_2, DispatchPattern=[True, False])  # -> ListA, ListB
dispatch_3 = Dispatch(List=branch, DispatchPattern=[True, False])  # -> ListA, ListB

# ---- group: Posiciones tubos / Lineas impares
crv = Curve(dispatch_2.ListA)

# ---- group: Posiciones tubos / Lineas pares
crv_2 = Curve(dispatch_3.ListB)

# ---- group: Posiciones tubos (continued)
tstat_2 = TreeStatistics(Tree=crv)  # -> Paths, Length, Count
path_mapper = PathMapper(crv_2, source="{A}", target="{A-1}")
panel_9 = Panel(tstat_2.Paths)
tstat_3 = TreeStatistics(Tree=path_mapper)  # -> Paths, Length, Count
dpath = DeconstructPath(Branch=panel_9)
panel_10 = Panel(tstat_3.Paths)
division_3 = Division(A=dpath, B="2")
dpath_2 = DeconstructPath(Branch=panel_10)
neg = Negative(Value=division_3)
division_4 = Division(A=dpath_2, B="2")
shift = ShiftList(List=crv, Shift=division_3, Wrap=Toggle(False))
neg_2 = Negative(Value=division_4)
shift_2 = ShiftList(List=crv_2, Shift=division_4, Wrap=Toggle(False))
shift_3 = ShiftList(List=shift, Shift=neg, Wrap=Toggle(False))
shift_4 = ShiftList(List=shift_2, Shift=expr("x-1", neg_2), Wrap=Toggle(False))
suirify_2 = Suirify(shift_3)
path_mapper_2 = PathMapper(suirify_2, source="{A}", target="{2*A}")
suirify_3 = Suirify(shift_4)
path_mapper_3 = PathMapper(suirify_3, source="{A}", target="{2*A+1}")
merge_4 = Merge(Data1=path_mapper_2, Data2=path_mapper_3)

# ---- group: Extrusión cilindros
Z_4 = UnitZ(Factor="90")
extr = Extrude(Base=merge_4, Direction=Z_4)
cap = CapHoles(Brep=extr)
debrep_2 = DeconstructBrep(Brep=cap)  # -> Faces, Edges, Vertices

# ----
item_2 = ListItem(List=debrep_2.Faces, Index=0, Wrap=True)  # -> Item, Item1
area_2 = Area(Geometry=item_2.Item1)  # -> Area, flatten(Centroid)
split = SplitList(List=flatten(cap), Index=int)  # -> ListA, ListB
brep_2 = Brep(split.ListA)
pt_3 = Point(area_2.Centroid)
# CONFIGURACIÓN RLAB
move_3 = Move(Geometry=pt_3, Motion=Z)  # -> Geometry, Transform
xy_5 = XYPlane(Origin=move_3.Geometry)

# ---- group: speeddata
panel_11 = Panel("60")

# ----
rad_7 = Radians(Degrees=panel_11)

# ---- group: speeddata (continued)
speed_3 = CreateSpeed(
    Translation="50",
    Rotation=rad_7,
    ExternalTranslation=5000,
    ExternalRotation=18.84955592,
    AccelTranslation=2500,
    AccelAxis=12.56637061)

# ----
speed_4 = SpeedParameter(speed_3)
createtarget_2 = CreateTarget(Plane=xy_5, Configuration=list_2, Motion=list_3, Tool=tool_parameter_4, Speed=speed_4, Zone=zone_2, IsCartesian=True)
partition = PartitionList(List=createtarget_2, Size="3")
deconstructtarget_2 = DeconstructTarget(Target=partition)
deconstructtarget_3 = DeconstructTarget(Target=partition)  # -> Plane, Configuration, Motion, Tool, Speed, Zone
move_4 = Move(Geometry=deconstructtarget_2, Motion=Z_2)  # -> Geometry, Transform
createtarget_3 = CreateTarget(
    Plane=move_4.Geometry,
    Configuration=list_2,
    Motion=list_3,
    Tool=tool_parameter_4,
    Speed=speed_4,
    Zone=zone_2,
    Command=command_2,
    IsCartesian=True)
createtarget_4 = CreateTarget(
    Plane=deconstructtarget_3.Plane,
    Configuration=deconstructtarget_3.Configuration,
    Motion=deconstructtarget_3.Motion,
    Tool=deconstructtarget_3.Tool,
    Speed=deconstructtarget_3.Speed,
    Zone=deconstructtarget_3.Zone,
    IsCartesian=True)
createtarget_5 = CreateTarget(
    Plane=deconstructtarget_3.Plane,
    Configuration=deconstructtarget_3.Configuration,
    Motion=deconstructtarget_3.Motion,
    Tool=deconstructtarget_3.Tool,
    Speed=deconstructtarget_3.Speed,
    Zone=deconstructtarget_3.Zone,
    Command=command,
    IsCartesian=True)
item_3 = ListItem(List=createtarget_5, Index=0, Wrap=True)  # -> Item, Item1, Item2
item_4 = ListItem(List=createtarget_4, Index=0, Wrap=True)  # -> Item, Item1, Item2
item_5 = ListItem(List=createtarget_3, Index=0, Wrap=True)  # -> Item, Item1, Item2
merge_5 = Merge(Data1=item_3.Item1, Data2=item_5.Item1, Data3=item_4.Item1)
merge_6 = Merge(Data1=item_3.Item2, Data2=item_5.Item2, Data3=item_4.Item2)
merge_7 = Merge(Data1=item_3.Item, Data2=item_5.Item, Data3=item_4.Item)
merge_8 = Merge(Data1=merge_7, Data2=merge_5, Data3=merge_6)
partition_2 = PartitionList(List=merge_8, Size="9")
ins = InsertItems(List=partition_2, Item=createtarget, Indices="0", Wrap=True)

# ---- group: OUTPUT / Calculo y simulación del programa
panel_12 = Panel("Arcillado")
division_5 = Division(B="60")  # -> flatten(Result)
panel_13 = Panel(division_5)

# ----
createprogram = CreateProgram(Name=panel_12, RobotSystem=robot_system_parameter_2, Targets=flatten(ins), StepSize=1)  # -> Program, Code, Duration, Warnings, Errors
panel_14 = Panel(createprogram.Code)

# ---- group: OUTPUT / Calculo y simulación del programa (continued)
sim = ProgramSimulation(Program=createprogram.Program, Time=Slider(0, range=0..1), Normalized=True)  # -> SystemMeshes, JointRotations, Plane, Index, Time, Program, Errors

# ----
remoteconnection = RemoteConnection(Program=sim.Program, Upload=button, Play=button_3, Pause=button_2)
panel_15 = Panel(remoteconnection)

# ---- group: OUTPUT / REPRESENTACIÓN
linetype = ModelLinetype({Path="(Continuous)", Segments=[]})
panel_16 = Panel("""10
-6""")
panel_17 = Panel("2")
trail = SimpleTrail(Program=sim.Program, Length="100000", MechanicalGroup=0)
material = CreateMaterial(
    Diffuse=ColourSwatch(SwatchColor=RGB(222, 117, 47)),
    Specular=RGB(255, 255, 255),
    Emission=RGB(0, 0, 0),
    Transparency=0,
    Shine=0)
preview = CustomPreview(Geometry=sim.SystemMeshes, Material=material)

# ---- group: Upgraded : Model Linetype
linetype_2 = ModelLinetype(Linetype=linetype, Segments=panel_16, WidthUnits=panel_17)  # -> Linetype, Name, Segments, CapStyle, JoinStyle, Width, WidthUnits
ss = ScalingStyle()  # disabled

# ---- group: OUTPUT / REPRESENTACIÓN (continued)
curve_preview = CustomCurvePreview(Curve=trail, Linetype=linetype_2.Linetype, Colour=ColourSwatch(SwatchColor=RGB(255, 255, 255)))
